# Grasshopper definition ActivationDeactivationOfElements_CustomComponent.gh (Grasshopper 1.0.7)
# plug-ins: TensionElim, karambaGH

Y = UnitY(Factor=1)
panel = Panel("""0
1
2
3
1
4
5
4""")
panel_2 = Panel("""1
2
3
1
4
5
2
2""")
panel_3 = Panel("""0
3""")
supp = Support(PosInd=panel_3, menu=[buttons(on, on, on, off, on, on)])
loads = LoadsKaramba3D(ForceVector=Y, Local=False, PosInd="4", LCase=0, mode="Point")
indtobeam = IndexToBeamKaramba3D(IndexA=panel, IndexB=panel_2)
pt = Point([Point(0, 0, 0), Point(1, 0, 0), Point(1, 1, 0), Point(0, 1, 0), Point(2, 0, 0), Point(2, 1, 0)])
assemble = AssembleModelKaramba(Point=pt, Elem=indtobeam, Support=supp, Load=loads, LimitDistance_m=0.005)  # -> Model, Info, Mass_kg, CenterOfGravity
modelview = ModelViewKaramba3D(Model=assemble.Model, ResultFactors=1, ResultCase=-1)  # -> Model, DeformedMesh, DeformedAxes, DeformedModel
number_slider = Slider(2, range=0..5)
tensionelim = TensionElim(Model_in=modelview.Model, Maxiter=number_slider)  # -> Model_out, IsActive, MaximumDisplacement
c_script = CSharpScript(
    Model_in=modelview.Model,
    maxiter=number_slider,
    Reference=["C:\Program Files\Rhino 6\Plug-ins\Karamba\karamba.gha", "C:\Program Files\Rhino 6\Plug-ins\Karamba\karambaCommon.dll"])  # -> out, Model_out, isActive, maxDisp; inputs maxiter: Int32
# ---------- c_script: C# usings ----------
using Karamba.Models;
using Karamba.GHopper.Models;
# ---------- c_script: C# ----------
    var model = Model_in as Model;
    if (model == null) {
      throw new ArgumentException("The input in 'Model_in' is not of type karamba.Models.Model!");
    }

    // load case to consider for elimination of elements
    int lc_num = 0;

    // clone the model and its list of elements to avoid side effects
    model = model.Clone();
    // clone its elements to avoid side effects
    model.cloneElements();
    // clone the feb-model to avoid side effects
    model.deepCloneFEModel();

    string singular_system_msg = "The stiffness matrix of the system is singular.";

    // do the iteration and remove elements with tensile axial forces
    for (int iter = 0; iter < maxiter; iter++) {

      // create a deform and response object for calculating and retrieving results
      feb.Deform deform = new feb.Deform(model.febmodel);
      feb.Response response = new feb.Response(deform);

      try
      {
        // calculate the displacements
        response.updateNodalDisplacements();
        // calculate the member forces
        response.updateMemberForces();
      }
      catch
      {
        // send an error message in case something went wrong
        throw new Exception(singular_system_msg);
      }

      // check the normal force of each element and deactivate those under tension
      double N, V, M;
      bool has_changed = false;
      foreach (Karamba.Elements.ModelElement elem in model.elems) {
        // retrieve resultant cross section forces
        elem.resultantCroSecForces(model, lc_num, out N, out V, out M);
        // check whether normal force is tensile
        if (N >= 0) {
          // set element inactive
          elem.set_is_active(model, false);
          has_changed = true;
        }
      }

      // leave iteration loop if nothing changed
      if (!has_changed) break;

      // if something changed inform the feb-model about it (otherwise it won't recalculate)
      model.febmodel.touch();

      // this guards the objects from being freed prematurely
      GC.KeepAlive(deform);
      GC.KeepAlive(response);
    }

    // update model to its final state
    try
    {
      // create a deform and response object for calculating and retrieving results
      feb.Deform deform = new feb.Deform(model.febmodel);
      feb.Response response = new feb.Response(deform);

      // calculate the displacements
      response.updateNodalDisplacements();
      // calculate the member forces
      response.updateMemberForces();

      maxDisp = response.maxDisplacement();

      // this guards the objects from being freed prematurely
      GC.KeepAlive(deform);
      GC.KeepAlive(response);
    }
    catch
    {
      // send an error message in case something went wrong
      throw new Exception(singular_system_msg);
    }

    // set up list of true/false values that corresponds to the elemment states
    List<bool> elem_activity = new List<bool>();
    foreach (var elem in model.elems) {
      elem_activity.Add(elem.is_active);
    }

    isActive = elem_activity;
    Model_out = new GH_Model(model);

    Print("Everything OK");
# ---------- end c_script ----------
panel_4 = Panel(tensionelim.IsActive)
panel_5 = Panel(tensionelim.MaximumDisplacement)
beamview = BeamViewKaramba3D(Model=tensionelim.Model_out)  # -> Model, MeshesOfRenderedBeams, DeformedBeamAxes, LegendColors, LegendTags
