# Grasshopper definition CrossSectionOptimization.gh (Grasshopper 1.0.7)
# plug-ins: karambaGH

X = UnitX(Factor=1)
pt = Point("0,1,0")
range = Range(Domain=Domain(0, 1), Steps=Slider(20, range=1..20))
line = LineSDL(Start=pt, Direction=X, Length=Slider(20, range=1..30))
line_2 = Line(line)
end = EndPoints(Curve=line_2)  # -> Start, End
shatter = Shatter(Curve=line, Parameters=range)
Z = UnitZ(Factor="-110")
supp = SupportKaramba3D(PosInd=end.Start, menu=[buttons(on, on, on, on, on, on)])
loads_karamba3d = LoadsKaramba3D(ForceVector=Z, Local=False, PosInd=end.End, LCase=0, mode="Point")
linetobeam = LineToBeamKaramba3D(Line=shatter, New=True, Remove=True, LimitDistance_m=0.005)  # -> Element, Points, Info
crosecrselect = CrossSectionRangeSelectorKaramba3D(MaximumHeight_cm=-1, MaximumWidth_cm=-1, menu=[dropdown(1), dropdown(1), dropdown(3)])
assemble = AssembleModelKaramba3D(Elem=linetobeam.Element, Support=supp, Load=loads_karamba3d, LimitDistance_m=0.005)  # -> Model, Info, Mass_kg, CenterOfGravity
c_script = CSharpScript(
    Model_in=assemble.Model,
    CroSecs_in=crosecrselect,
    niter="10",
    lcind="0",
    Reference=["C:\Program Files\Rhino 6\Plug-ins\Karamba\karamba.gha", "C:\Program Files\Rhino 6\Plug-ins\Karamba\karambaCommon.dll"])  # -> out, Model_out, Disp_out; inputs CroSecs_in: list, niter: Int32, lcind: Int32
# ---------- c_script: C# usings ----------
using Karamba.Models;
using Karamba.CrossSections;
using Karamba.Elements;
using Karamba.Results;
# ---------- c_script: C# ----------
    var model = Model_in as Model;
    if (model == null) {
      throw new ArgumentException("The input in 'Model_in' is not of type Karamba.Models.Model!");
    }

    var crosecs = new List<CroSec_Beam>(CroSecs_in.Count);
    foreach (var item in CroSecs_in) {
      var crosec = item as CroSec_Beam;
      if (crosec == null) {
        throw new ArgumentException("The input in 'CroSecs_in' contains objects which are not of type Karamba.CrossSections.CroSec_Beam!");
      }
      crosecs.Add(crosec);
    }

    var k3d = new KarambaCommon.Toolkit();
    List<double> max_disp;
    List<double> out_g;
    List<double> out_comp;
    string message;
    List<List<double>> N;
    List<List<double>> V;
    List<List<double>> M;

    // avoid side effects
    model = model.Clone();
    model.cloneElements();

    for (int i = 0; i < niter; ++i) {
      model = k3d.Algorithms.AnalyzeThI(model, out max_disp, out out_g, out out_comp, out message);

      for (int elem_ind = 0; elem_ind < model.elems.Count; ++elem_ind) {
        var beam = model.elems[elem_ind] as ModelBeam;
        if (beam == null) continue;

        // avoid side effects
        beam = (ModelBeam) beam.Clone();
        model.elems[elem_ind] = beam;

        BeamResultantForces.solve(model, new List<string> {"" + elem_ind}, lcind, 100, 1,
          out N, out V, out M);

        for (int crosec_ind = 0; crosec_ind < crosecs.Count; ++crosec_ind) {
          var crosec = crosecs[crosec_ind];
          beam.crosec = crosec;
          var max_sigma = Math.Abs(N[lcind][0]) / crosec.A + M[lcind][0] / crosec.Wely_z_pos;
          if (max_sigma < crosec.material.fy()) break;
        }
      }

      model.initMaterialCroSecLists();
      model.febmodel = model.buildFEModel();
    }

    model = k3d.Algorithms.AnalyzeThI(model, out max_disp, out out_g, out out_comp, out message);

    Disp_out = new GH_Number(max_disp[lcind]);

    Model_out = new Karamba.GHopper.Models.GH_Model(model);
# ---------- end c_script ----------
panel = Panel(c_script.Disp_out)
disassemble = DisassembleModelKaramba3D(Model=c_script.Model_out)  # -> Model, Point, Beam, Shell, Support, Load, Line, Mesh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
modelview = ModelViewKaramba3D(Model=c_script.Model_out, ResultFactors=1, ResultCase=-1)  # -> Model, DeformedMesh, DeformedAxes, DeformedModel
assemble_2 = AssembleModelKaramba3D(Elem=disassemble.Beam, Support=disassemble.Support, Load=disassemble.Load, LimitDistance_m=0.005)  # -> Model, Info, Mass_kg, CenterOfGravity
beamview = BeamViewKaramba3D(Model=modelview.Model)  # -> Model, MeshesOfRenderedBeams, DeformedBeamAxes, LegendColors, LegendTags
analyze = AnalyzeKaramba3D(Model=assemble_2.Model)  # -> CalculatedModel, MaximumDisplacement_cm, ResultingForceOfGravity_kN, ElasticEnergy_kNm
legend = Legend(Colour=beamview.LegendColors, Tags=beamview.LegendTags, LegendType=1)
panel_2 = Panel(analyze.MaximumDisplacement_cm)
