# Grasshopper definition HelloKaramba3D.gh (Grasshopper 1.0.7)
# plug-ins: karambaGH

X = UnitX(Factor=1)
line = LineSDL(Start="0,1,0", Direction=X, Length=Slider(3, range=1..5))
linetobeam = LineToBeamKaramba3D(Line=line, New=True, Remove=True, LimitDistance_m=0.005)  # -> Element, Points, Info
assemble = AssembleModelKaramba3D(Elem=linetobeam.Element, LimitDistance_m=0.005)  # -> Model, Info, Mass_kg, CenterOfGravity
hello_k3d = CSharpScript(
    Model_in=assemble.Model,
    Reference=["C:\REPOS\K3D_DOC\KARAMBADOC\SCRIPTINGMANUAL\SCRIPTINGGUIDEEXAMPLES\TensionElim\TensionElim\bin\karambaCommon.dll", "C:\REPOS\K3D_DOC\KARAMBADOC\SCRIPTINGMANUAL\SCRIPTINGGUIDEEXAMPLES\TensionElim\TensionElim\bin\karamba.gha"])  # -> out
# ---------- hello_k3d: C# usings ----------
using Karamba.Models;
# ---------- hello_k3d: C# ----------
    var model = Model_in as Model;
    if (model == null) {
      throw new ArgumentException("The input is not of type model!");
    }
    Print("Number of Elements: " + model.elems.Count);
    Print("Number of Materials: " + model.materials.Count);
    Print("Number of Cross sections: " + model.crosecs.Count);
# ---------- end hello_k3d ----------
panel = Panel(hello_k3d)
