# Grasshopper definition SimpleShellEso.gh (Grasshopper 1.0.7)
# plug-ins: karambaGH

height = Slider(4, range=0..100)
nheight = Slider(6, range=0..20)
length = Slider(10, range=0..100)
nlength = Slider(8, range=0..20)

vec = VectorXYZ(XComponent=0, YComponent=0, ZComponent=0)  # -> Vector, Length
vec_2 = VectorXYZ(XComponent=length, YComponent=0, ZComponent=0)  # -> Vector, Length
vec_3 = VectorXYZ(XComponent=length, YComponent=height, ZComponent=0)  # -> Vector, Length
vec_4 = VectorXYZ(XComponent=0, YComponent=height, ZComponent=0)  # -> Vector, Length
srf4pt = _4PointSurface(CornerA=vec.Vector, CornerB=vec_2.Vector, CornerC=vec_3.Vector, CornerD=vec_4.Vector)
edges = BrepEdges(Brep=srf4pt)  # -> Naked, Interior, NonManifold
list_item = ListItem(List=edges.Naked, Index=expr("1", 0), Wrap=True)
mesh_uv = MeshSurface(Surface=srf4pt, UCount=nlength, VCount=nheight, Overhang=True, Equalize=False)
divide = DivideCurve(Curve=list_item, Count=nheight, Kinks=False)  # -> Points, Tangents, Parameters
tri = Triangulate(Mesh=mesh_uv)  # -> Mesh, Count
Y = UnitY(Factor="-1")
supp = SupportKaramba(PosInd=flatten(divide.Points), menu=[buttons(on, on, on, on, on, on)])
loads_karamba3d = LoadsKaramba3D(ForceVector=Y, Local=False, PosInd=vec_4.Vector, LCase=0, mode="Point")
meshtoshell = MeshToShellKaramba3D(Mesh=tri.Mesh, LimitDistance_m=0.005)  # -> Element, Points, Info
assemble = AssembleModelKaramba3D(Elem=meshtoshell.Element, Support=supp, Load=loads_karamba3d, LimitDistance_m=0.005)  # -> Model, Info, Mass_kg, CenterOfGravity
analyze = AnalyzeKaramba3D(Model=assemble.Model)  # -> CalculatedModel, MaximumDisplacement_cm, ResultingForceOfGravity_kN, ElasticEnergy_kNm
modelview = ModelViewKaramba3D(Model=analyze.CalculatedModel, ResultFactors=1, ResultCase=-1)  # -> Model, DeformedMesh, DeformedAxes, DeformedModel
beamview = BeamViewKaramba3D(Model=modelview.Model)  # -> Model, MeshesOfRenderedBeams, DeformedBeamAxes, LegendColors, LegendTags
shellresults = PythonScript(Model_in=beamview.Model)  # -> out
# ---------- shellresults: Python ----------
import clr

clr.AddReferenceToFileAndPath("C:\Program Files\Rhino 6\Plug-ins\karamba\karamba.gha")
clr.AddReferenceToFileAndPath("C:\Program Files\Rhino 6\Plug-ins\karamba\karambaCommon.dll")

import Karamba.Models.Model as Model
import Karamba.Elements.ModelShell as Shell
import feb.ShellMesh as ShellMesh
import feb.TriShell3D as TriShell
import feb.VectSurface3DSigEps as TriStates
import feb.EnergyVisitor as EnergyVisitor

for element in Model_in.elems:
   if type(element) != Shell:
       continue
       
   print "shell!"
   femesh = Model_in.febmodel.triMesh(element.fe_id)
   n_tri = femesh.numberOfElems()
   print "number of triangle elements:", n_tri
   
   energy_visitor = EnergyVisitor(Model_in.febmodel, Model_in.febmodel.state(0), 0);
   energy_visitor.visit(Model_in.febmodel);
            
   for ind in xrange(n_tri):
       print "Axial Energy ", energy_visitor.axialEnergy(Model_in.elems[0].fe_id + ind)
       print "Bending Energy ", energy_visitor.bendingEnergy(Model_in.elems[0].fe_id + ind)
   
   tri_states = femesh.elementSigEps(Model_in.febmodel, 0, Model_in.superimpFacsStates)
   for tri_state in tri_states:
       s = tri_state.sig_princ()
       print "first principal stress (kN/cm2):",s.x()/10000
       print "second principal stress (kN/cm2):",s.y()/10000
       
print "Number of elements", Model_in.elems.Count
# ---------- end shellresults ----------
panel = Panel(shellresults)
simpleeso = PythonScript(Model_in=beamview.Model, NIter=Slider(10, range=0..10), NRemove=Slider(42, range=0..50))  # -> out, activeMesh, inactiveMesh; inputs NIter: Int32, NRemove: Int32
# ---------- simpleeso: Python ----------
#---
# A simple ESO procedure for shell elements.
# No filters are  applied thus checkerboard patterns 
# will result
#---

import clr

clr.AddReferenceToFileAndPath("C:\Program Files\Rhino 6\Plug-ins\karamba\Karamba.gha")
clr.AddReferenceToFileAndPath("C:\Program Files\Rhino 6\Plug-ins\karamba\KarambaCommon.dll")

import Karamba.Models.Model as Model
import Karamba.Elements.ModelShell as Shell
import Karamba.Materials.FemMaterial_Isotrop as FemMaterial
import feb.ShellMesh as ShellMesh
import feb.TriShell3D as TriShell3D
import feb.VectSurface3DSigEps as TriStates
import feb.Deform as Deform
import feb.Response as Response
import feb.EnergyVisitor as EnergyVisitor
import Rhino.Geometry as Rh

from operator import attrgetter

# encapsulate ESO properties of shell elements
class EsoItem:
    def __init__(self, shell_elem, elem_ind):
       self.active = True
       self.fitness = 0
       self.shell_elem = shell_elem
       self.area = shell_elem.area()
       self.ind = elem_ind

    def update(self, energy_visitor):
       self.fitness = energy_visitor.elasticEnergy(self.ind) / self.area
        

# clone model to avoid side effects
model = Model_in.Clone()
model.deepCloneFEModel()

# generate ESO properties of each triangular shell element
eso_items = []
for elem in model.elems:
    if type(elem) != Shell:
       continue
    tri_mesh = model.febmodel.triMesh(elem.fe_id)
    for i in xrange(tri_mesh.numberOfElems()):
        eso_items.append(EsoItem(tri_mesh.elem(i), i))

nremove_per_iter = int(NRemove/NIter+1)
n_removed = 0

# do the ESO iterations
for iter in xrange(NIter):
    analysis = Deform(model.febmodel)
    response = Response(analysis)

    try:
        response.updateNodalDisplacements()
        response.updateMemberForces()
    except:
        raise Exception("singular stiffness")

    energy_visitor = EnergyVisitor(model.febmodel, model.febmodel.state(0), 0);
    energy_visitor.visit(model.febmodel);
   
    for eso_item in eso_items:
        eso_item.update(energy_visitor)

    eso_items = sorted(eso_items, key = attrgetter("fitness"))

    n_removed_per_iter = 0
    has_changed = False
    for eso_item in eso_items:
        if (n_removed >= NRemove): break
        if (n_removed_per_iter >= nremove_per_iter): break
        if (eso_item.active == False):
            continue
        eso_item.shell_elem.softKilled(True)
        eso_item.active = False
        n_removed +=1
        n_removed_per_iter +=1
     
    has_changed = True
    if (has_changed == False):
        break
    model.febmodel.touch()

    # create active and inactive mesh for output
    active_mesh = Rh.Mesh()
    inactive_mesh = Rh.Mesh()
    for i in xrange(model.febmodel.numberOfNodes()):
        feb_pos = model.febmodel.node(i).pos()
        active_mesh.Vertices.Add(Rh.Point3d(feb_pos.x(), feb_pos.y(), feb_pos.z()))
        inactive_mesh.Vertices.Add(Rh.Point3d(feb_pos.x(), feb_pos.y(), feb_pos.z()))
        
    for eso_item in eso_items:
        ind0 = eso_item.shell_elem.node(0).ind()
        ind1 = eso_item.shell_elem.node(1).ind()
        ind2 = eso_item.shell_elem.node(2).ind()
        if (eso_item.active):
            active_mesh.Faces.AddFace(Rh.MeshFace(ind0, ind1, ind2))
        else:
            inactive_mesh.Faces.AddFace(Rh.MeshFace(ind0, ind1, ind2))
                
    activeMesh = active_mesh
    inactiveMesh = inactive_mesh
# ---------- end simpleeso ----------
mesh = Mesh(simpleeso.activeMesh)
