# Grasshopper definition DataRetrieval.gh (Grasshopper 1.0.7)
# plug-ins: karambaGH

X = UnitX(Factor=1)
Y = UnitY(Factor=1)
line = LineSDL(Start="0,1,0", Direction=X, Length=Slider(3, range=1..5))
line_2 = LineSDL(Start="0,1,0", Direction=Y, Length=Slider(3, range=1..5))
merge = Merge(Data1=line, Data2=line_2)
crosecrselect = CrossSectionRangeSelectorKaramba3D(MaximumHeight_cm=-1, MaximumWidth_cm=-1, menu=[dropdown(1), dropdown(1), dropdown(3)])
matselect = MaterialSelectionKaramba3D(menu=[dropdown(3), dropdown(6)])
crosecselect = CrossSectionSelectorKaramba3D(CrossSections=crosecrselect, NameOrListIndexOfCrossSection="HEA100")  # -> CrossSection, Info
cross_section = CrossSectionKaramba3D(
    FamilyNameOfCrossSection="DefaultCroSec",
    Material=matselect,
    Height_cm=10,
    UpperFlangeWidth_cm=5,
    LowerFlangeWidth_cm=5,
    mode="Trapezoid")
merge_2 = Merge(Data1=crosecselect.CrossSection, Data2=cross_section)  # -> flatten(Result)
linetobeam = LineToBeamKaramba3D(Line=merge, CrossSection=merge_2, New=True, Remove=True, LimitDistance_m=0.005)  # -> Element, Points, Info
assemble = AssembleModelKaramba3D(Elem=linetobeam.Element, LimitDistance_m=0.005)  # -> Model, Info, Mass_kg, CenterOfGravity
panel = Panel(assemble.Mass_kg)
hello_k3d = CSharpScript(
    Model_in=assemble.Model,
    Reference=["C:\Program Files\Rhino 6\Plug-ins\Karamba\karamba.gha", "C:\Program Files\Rhino 6\Plug-ins\Karamba\karambaCommon.dll"])  # -> out
# ---------- hello_k3d: C# usings ----------
using Karamba.Models;
using Karamba.Utilities;
using Karamba.Materials;
# ---------- hello_k3d: C# ----------
    var model = Model_in as Model;
    if (model == null) {
      throw new ArgumentException("The input is not of type Karamba.Models.Model!");
    }

    var matWeights = new Dictionary<FemMaterial, double>();

    foreach (var elem in model.elems) {
      var mat = elem.crosec.material;
      if (!matWeights.ContainsKey(mat)){
        matWeights[mat] = 0;
      }
      matWeights[mat] += elem.weight(model.nodes);
    }

    var ucf = UnitsConversionFactories.Conv();
    var kg = ucf.weight2kg();
    
    foreach (var entry in matWeights) {
      Print("Material: " + entry.Key.name + ": " + kg.toBase(entry.Value) + kg.unitB);
    }
# ---------- end hello_k3d ----------
panel_2 = Panel(hello_k3d)
