# Grasshopper definition ModelExport.gh (Grasshopper 1.0.7)
# plug-ins: karambaGH

Z = UnitZ(Factor="-5")
planesrf = PlaneSurface(Plane=PlaneXY(0, 0, 0), XSize=Domain(-10, 10), YSize=Domain(-10, 10))
loads_karamba3d = LoadsKaramba3D(Vector=Z, LCase=0, mode="Uniform Line", menu=[buttons(on, off, off)])
mesh_uv = MeshSurface(Surface=planesrf, UCount=5, VCount=5, Overhang=True, Equalize=False)
Z_2 = UnitZ(Factor=1)
loads_karamba3d_2 = LoadsKaramba3D(Vector=Z_2, Mesh=mesh_uv, LCase=0, mode="MeshLoad -Const.", menu=[buttons(on, off, off), buttons(on, on)])
X = UnitX(Factor=1)
loads_karamba3d_3 = LoadsKaramba3D(Vector=Vector(0, 0, -1), LCase=0, mode="Gravity")
Z_3 = UnitZ(Factor="-1.5")
supp = SupportKaramba3D(PosInd="0", menu=[buttons(on, on, on, on, on, on)])
line = LineSDL(Start="0,1,0", Direction=X, Length=Slider(1, range=1..10))
loads_karamba3d_4 = LoadsKaramba3D(ForceVector=Z_3, Local=False, PosInd="1", LCase=0, mode="Point")
linetobeam = LineToBeamKaramba3D(Line=line, New=True, Remove=True, LimitDistance_m=0.005)  # -> Element, Points, Info
load = LoadKaramba3D([loads_karamba3d_3, loads_karamba3d_4, loads_karamba3d, loads_karamba3d_2])
assemble = AssembleModelKaramba3D(Elem=linetobeam.Element, Support=supp, Load=load, LimitDistance_m=0.005)  # -> Model, Info, Mass_kg, CenterOfGravity
license_karamba3d = LicenseKaramba3D()
modelview = ModelViewKaramba3D(Model=assemble.Model, ResultFactors=1, ResultCase=-1)  # -> Model, DeformedMesh, DeformedAxes, DeformedModel
beamview = BeamViewKaramba3D(Model=modelview.Model)  # -> Model, MeshesOfRenderedBeams, DeformedBeamAxes, LegendColors, LegendTags
c_script = CSharpScript(
    Model_in=beamview.Model,
    Reference=["C:\Program Files\Rhino 6\Plug-ins\Karamba\karamba.gha", "C:\Program Files\Rhino 6\Plug-ins\Karamba\karambaCommon.dll"])  # -> out, XML
# ---------- c_script: C# usings ----------
using System.Xml;
using System.IO;
using Karamba.Models;
using Karamba.Nodes;
using Karamba.CrossSections;
using Karamba.Elements;
using Karamba.Loads;
using Karamba.Materials;
using Karamba.Supports;
using Karamba.Geometry;
# ---------- c_script: C# ----------
    var model = Model_in as Model;
    if (model == null) {
      throw new ArgumentException("The input is not of type model!");
    }

    var builder = new BuilderXML();
    var director = new Karamba.Exporters.ExportDirector();
    director.ConstructExport(model, builder);

    XML = builder.getProduct();
# ---------- c_script: C# additional code ----------
  public class BuilderXML : Karamba.Exporters.ExportBuilder {
    // the XML document
    private XmlDocument doc_ = new XmlDocument();
    // the model inside the xml-document
    private XmlElement model_;

    public override void newProduct() {
      model_ = (XmlElement) doc_.AppendChild(doc_.CreateElement("K3DModel"));
    }

    public override void buildMaterial(FemMaterial m, int ind) {
      var xml_node = (XmlElement) model_.AppendChild(doc_.CreateElement("FemMaterial"));
      xml_node.InnerText = "ind: " + ind + ":" + m.ToString();
    }

    public override void buildVertex(Node v) {
      var xml_node = (XmlElement) model_.AppendChild(doc_.CreateElement("Node"));
      xml_node.InnerText = v.ToString();
    }

    public override void buildCroSec(CroSec crosec) {
      var xml_node = (XmlElement) model_.AppendChild(doc_.CreateElement("CroSec"));
      xml_node.InnerText = crosec.ToString();
    }

    public override void buildElement(ModelElement e, Model model) {
      var xml_node = (XmlElement) model_.AppendChild(doc_.CreateElement("ModelElement"));
      xml_node.InnerText = e.ToString();
    }

    public override void buildElementLoad(ModelElement elem, Model model) {
      foreach (var l in elem.Elem_loads) {
        var xml_node = (XmlElement) model_.AppendChild(doc_.CreateElement("ElementLoad"));
        xml_node.InnerText = l.ToString();
      }
    }

    public override void buildLoadCase(int lc_ind, Model model) {
      Vector3 g_vec = new Vector3(0, 0, 0);
      foreach (GravityLoad g in model.gravities.Values) {
        if (g.loadcase < 0 || g.loadcase == lc_ind) {
          g_vec = g.force;
          };
      }

      var xml_node = (XmlElement) model_.AppendChild(doc_.CreateElement("LoadCase"));
      xml_node.InnerText = "load-case: " + lc_ind + " g =" + g_vec;

    }

    public override void buildSupport(Support s) {
      var xml_node = (XmlElement) model_.AppendChild(doc_.CreateElement("Support"));
      xml_node.InnerText = s.ToString();
    }

    public override void buildPointLoad(PointLoad p) {
      var xml_node = (XmlElement) model_.AppendChild(doc_.CreateElement("PointLoad"));
      xml_node.InnerText = p.ToString();
    }

    public override void buildMeshLoad(MeshLoad m) {
      var xml_node = (XmlElement) model_.AppendChild(doc_.CreateElement("MeshLoad"));
      xml_node.InnerText = m.ToString();
    }

    public string getProduct() {
      StringWriter sw = new StringWriter();
      XmlTextWriter tx = new XmlTextWriter(sw);
      doc_.WriteTo(tx);
      string str = sw.ToString();//
      return str;
    }
  }
# ---------- end c_script ----------
panel = Panel(c_script.XML)
